# Grasshopper definition 01_Parametric_Box.gh (Grasshopper 1.0.7)

# Title: Parametric Box
# 
# Tutorial number: 1
# 
# Level:  Very Easy
# 
# Learn: Basic components, number sliders, geometry creation
# 
# Goal: Create a scalable box using number sliders and extrusion.
xy = XYPlane(Origin=Point(0, 0, 0))
rectangle = Rectangle(Plane=xy, XSize=Slider(2000, range=0..2000), YSize=Slider(2000, range=0..2000), Radius=0)  # -> Rectangle, Length
boxrec = BoxRectangle(Rectangle=rectangle.Rectangle, Height=Slider(2000, range=0..2000))
brep = Brep(boxrec)
