# Grasshopper definition 02_Parametric_Tower_Massing.gh (Grasshopper 1.0.7)

floor_height = Slider(3000, range=0..4000)
no_of_floors = Slider(4, range=0..10)
xy = XYPlane(Origin=Point(0, 0, 0))
rectangle = Rectangle(Plane=xy, XSize=Slider(10000, range=0..10000), YSize=Slider(7727, range=0..10000), Radius=0)  # -> Rectangle, Length
series = Series(Start="0", Step=floor_height, Count=no_of_floors)
vec = VectorXYZ(XComponent=0, YComponent=0, ZComponent=series)  # -> Vector, Length
move = Move(Geometry=rectangle.Rectangle, Motion=vec.Vector)  # -> Geometry, Transform
boxrec = BoxRectangle(Rectangle=move.Geometry, Height=Slider(200, range=0..300))
brep = Brep(boxrec)
