# Grasshopper definition Adaptive_Facade_with_Panels.gh (Grasshopper 1.0.7)

number_slider = Slider(0, range=0..10)
number_slider_2 = Slider(7, range=0..10)
number_slider_3 = Slider(5, range=0..10)
xy = XYPlane(Origin=Point(0, 0, 0))
rectangle = Rectangle(Plane=xy, XSize=Slider(10000, range=0..10000), YSize=Slider(7727, range=0..10000), Radius=0)  # -> Rectangle, Length
vec = VectorXYZ(XComponent=number_slider, YComponent=number_slider_2, ZComponent=number_slider_3)  # -> Vector, Length
pt = ConstructPoint(XCoordinate=number_slider, YCoordinate=number_slider_2, ZCoordinate=number_slider_3)
vdis = VectorDisplay(Anchor=pt, Vector=vec.Vector)
sdivide = DivideSurface(Surface=rectangle.Rectangle, UCount=Slider(20, range=0..20), VCount=Slider(10, range=0..20))  # -> Points, Normals, Parameters
vdis_2 = VectorDisplay(Anchor=sdivide.Points, Vector=sdivide.Normals)
xy_2 = XYPlane(Origin=sdivide.Points)
angle = Angle(VectorA=sdivide.Normals, VectorB=vec.Vector)  # -> Angle, Reflex
prot = RotatePlane(Plane=xy_2, Angle=angle.Angle)
number_slider_4 = Slider(250, range=0..250)
rectangle_2 = Rectangle(Plane=prot, XSize=number_slider_4, YSize=number_slider_4, Radius=0)  # -> Rectangle, Length
brep = Brep(rectangle_2.Rectangle)
