# Grasshopper definition Patterned_Facade_using-Attractors.gh (Grasshopper 1.0.7)

pt = ConstructPoint(XCoordinate=0, YCoordinate=0, ZCoordinate=0)
line = LineSDL(Start=pt, Direction="0,100,0", Length="10000")
divide = DivideCurve(Curve=line, Count=10, Kinks=False)  # -> Points, Tangents, Parameters
pt_2 = ConstructPoint(XCoordinate=Slider(0, range=0..20000), YCoordinate=Slider(493, range=0..1000), ZCoordinate=Slider(1000, range=0..1000))
lng = ListLength(List=divide.Points)
pdecon = Deconstruct(Point=divide.Points)  # -> XComponent, YComponent, ZComponent
random = Random(Range="0 To 1000", Number=lng, Seed=2)
pt_3 = ConstructPoint(XCoordinate=random, YCoordinate=pdecon.YComponent, ZCoordinate=pdecon.ZComponent)
intcrv = Interpolate(Vertices=pt_3, Degree=3, Periodic=False, KnotStyle=1)  # -> Curve, Length, Domain
extr = Extrude(Base=intcrv.Curve, Direction="0,0,10000")
sdivide = DivideSurface(Surface=extr, UCount=Slider(10, range=0..20), VCount=Slider(10, range=0..20))  # -> Points, Normals, Parameters
flatten = FlattenTree(Tree=sdivide.Points, Path="{0}")
graft = GraftTree(Tree=flatten, IncludeEmptyLists=True, IncludeNullItems=True)
dist = Distance(PointA=flatten, PointB=graft)
pl = PlaneNormal(Origin=flatten, ZAxis=flatten(sdivide.Normals))
sort = SortList(Keys=dist)  # -> Keys, ValuesA
item = ListItem(List=sort.Keys, Index=0, Wrap=True)  # -> Item, Item1
cset = CreateSet(List=flatten(item.Item1))  # -> Set, Map
dist_2 = Distance(PointA=flatten, PointB=pt_2)
sort_2 = SortList(Keys=dist_2)  # -> Keys, ValuesA
division = Division(A=cset.Set, B="2")
rev = ReverseList(List=sort_2.Keys)
item_2 = ListItem(List=rev, Index=0, Wrap=True)
division_2 = Division(A=dist_2, B=item_2)
multiplication = Multiplication(A=cset.Set, B=division_2)
neg = Negative(Value=division)
division_3 = Division(A=multiplication, B="2")
dom = ConstructDomain(DomainStart=neg, DomainEnd=division)
cir = Circle(Plane=pl, Radius=division_3)
rectangle = Rectangle(Plane=pl, XSize=dom, YSize=dom, Radius=0)  # -> Rectangle, Length
boundary = BoundarySurfaces(Edges=cir)
boundary_2 = BoundarySurfaces(Edges=rectangle.Rectangle)
sdiff = SolidDifference(BrepsA=boundary_2, BrepsB=boundary)
