# Grasshopper definition Responsive_Bench.gh (Grasshopper 1.0.7)

pt = ConstructPoint(XCoordinate=0, YCoordinate=0, ZCoordinate=0)
pt_2 = ConstructPoint(XCoordinate=Slider(0, range=0..100), YCoordinate=Slider(1586, range=0..2100), ZCoordinate=0)
series = Series(Start="0", Step=Slider(100, range=0..100), Count=Slider(20, range=0..100))
ln = Line(StartPoint=pt, EndPoint=pt_2)
divide = DivideCurve(Curve=ln, Count=10, Kinks=False)  # -> Points, Tangents, Parameters
pdecon = Deconstruct(Point=divide.Points)  # -> XComponent, YComponent, ZComponent
graph = GraphMapper(
    pdecon.YComponent,
    x0=0,
    x1=1,
    y0=0,
    y1=1,
    container_name="Sine",
    Equation_px=[0, 0.4275362194],
    Equation_py=[0, 0.6144931316])
multiplication = Multiplication(A=graph, B=Slider(140, range=0..1000))
pt_3 = ConstructPoint(XCoordinate=pdecon.XComponent, YCoordinate=pdecon.YComponent, ZCoordinate=multiplication)
X = UnitX(Factor=series)
intcrv = Interpolate(Vertices=pt_3, Degree=3, Periodic=False, KnotStyle=1)  # -> Curve, Length, Domain
move = Move(Geometry=intcrv.Curve, Motion=X)  # -> Geometry, Transform
loft = Loft(
    Curves=flatten(move.Geometry),
    Options={Adjust=False, Closed=False, LoftEnds=0, LoftSimp=0, LoftType=0, Rebuild=10, Refit=0.01})
